# Dynamo graph Geometry_Solids.dyn (Dynamo 2.2.1.5175)

select_model_element = DSModelElementSelection()  # 1 picked in the model
geometry = Element.Geometry(element=select_model_element)
# note: Geometry is not the same as a Revit Element:
# Use ImportInstance To create Revit Imports from Surfaces and Solids in any Revit Environment, use Points and Curves to place Family Instances, or create Form in Mass and Generic Model By Point (Adaptive Component) Families
byGeometries = ImportInstance.ByGeometries(geometries=geometry)
curves = PolyCurve.Curves()  # unwired: polyCurve
referenceCurveByCurve = ModelCurve.ReferenceCurveByCurve(curve=curves)
byLoftCrossSections = Form.ByLoftCrossSections(curves=referenceCurveByCurve)
byGeometry = BoundingBox.ByGeometry(geom=geometry)
toCuboid = BoundingBox.ToCuboid(boundingBox=byGeometry)
