# Dynamo graph ImportFile.dyn (Dynamo 2.8.0.2471)
# packages: SteamNodes 1.2.4, MeshToolkit 3.0.0

file_path = Filename("D:\Data\2016_03 E003 lidar\test0.2.rcs")
file_from_path = FileObject(path=file_path)
number_slider = DoubleSlider(7.1, range=0..100 step 0.1)
byLengths = Cuboid.ByLengths(width=number_slider, length=number_slider, height=number_slider)
boundingBox = Geometry.BoundingBox(geometry=byLengths)
getPointsFromBoxSelection = Custom[PointCloud.GetPointsFromBoxSelection](file_from_path, Box=boundingBox)  # package SteamNodes; WIP: collects the points from a point cloud instance by using a box shape collector (aka a Revit element such as a Mass). Mass geometry has to be a box (parallel faces). The number of points read must range from 1 to 1000000. Default 50000. Average Distance is a setting for PC density. Less distance increases the number of points.
file_path_2 = Filename("D:\Data\Mesh_castle\Building.obj")
importFile = Autodesk.Dynamo.MeshToolkit.Mesh.ImportFile(fileName=file_path_2)
